# Grasshopper definition fractals.gh (Grasshopper 1.0.7)

python = GhPythonScript()  # -> out, file
# ---------- python: Python ----------
import rhinoscriptsyntax as rs

filter = "GCode (*.gcode)|*.gcode|All Files (*.*)|*.*||"
file = rs.SaveFileName("", filter)
# ---------- end python ----------
python_2 = GhPythonScript(file=python.file)  # -> out, lines, extrusion, turtle
# ---------- python_2: Python ----------
# code required so that library reloads appropriately
# must be above other import statements
import sys
to_delete = list()
for module in sys.modules:
   if "extruder_turtle" in module:
      to_delete.append(module)  

for module in to_delete:
    sys.modules.pop(module)
    
import rhinoscriptsyntax as rs
import numbers
import extruder_turtle
from extruder_turtle import *
import math
import random

reload(extruder_turtle)

t = ExtruderTurtle()
t.use_degrees = True

## Set up the turtle
t.setup(x=100, y=100, z=0, filename=file)

extrude_width = .5
extrude_height = .2
layer_height = .3

'''
word = "frrfrrfrr"
rules = {
            "f": "flfrrflf",
            "r": "r",
            "l": "l"
            }

NUMBER_GENERATIONS = 4
sidelength = 50

t.rate(700)

angle = 60
layers = 40

for g in range(NUMBER_GENERATIONS):
    for l in range(layers):
        for r in word:
            if r == "f":
                t.forward(sidelength)
            elif r == "r":
                t.right(60)
            elif r == "l":
                t.left(60)
        t.lift(0.3)
    new_word = ""
    for r in word:
        new_word += rules[r]
    word = new_word
    sidelength = sidelength/3
'''

t.use_degrees = False
layers = 60
angle = math.pi/6
branches_per_layer = 6

def rhombus (size):
    t.forward(size)
    t.left(math.pi/6)
    t.forward(size)
    t.left(5*math.pi/6)
    t.forward(size)
    t.left(math.pi/6)
    t.forward(size)
    t.left(math.pi/6)
    t.left(math.pi/5)


for layer in range(layers):
    # trunk
    for l in range(10):
        t.extrude(0.1)
        t.lift(0.1)
    # branch
    branch_size = layers/6-layer/6
    for branches in range(6):
        rhombus(branch_size)
    

#####################################################


lines = []
for l in t.line_segs:
    if (rs.Distance(l[0], l[1]) != 0):
        lines.append(rs.AddLine(l[0], l[1]))

t.finish()
# ---------- end python_2 ----------
line = Line(python_2.lines)
srf = Surface(python_2.turtle)
pipe = Pipe(Curve=line, Radius=python_2.extrusion, Caps=0)
