# Grasshopper definition clay_oscillations.gh (Grasshopper 1.0.7)

python = GhPythonScript()  # -> out, file
# ---------- python: Python ----------
import rhinoscriptsyntax as rs

filter = "GCode (*.gcode)|*.gcode|All Files (*.*)|*.*||"
file = rs.SaveFileName("", filter)
# ---------- end python ----------
python_2 = GhPythonScript(file=python.file)  # -> out, lines, extrusion, turtle
# ---------- python_2: Python ----------
# code required so that library reloads appropriately
# must be above other import statements
import sys
to_delete = list()
for module in sys.modules:
    if "extruder_turtle" in module:
      to_delete.append(module)  
    if "basic_geometry" in module:
      to_delete.append(module) 
        
for module in to_delete:
    sys.modules.pop(module)
    
import rhinoscriptsyntax as rs
import numbers
import math
import random
import extruder_turtle
import basic_geometry
from extruder_turtle import *
from basic_geometry import *

reload(extruder_turtle)
reload(basic_geometry)

t = ExtruderTurtle()
t.use_degrees = True

## Set up the turtle
t.setup(x=0, y=0, z=1, filename=file)

t.set_extrude_rate(extrude_rate)
t.set_feedrate(800)

t.use_degrees = True

step_size = 150.0
dtheta = 360/step_size
amplitudeZ = .01
nOscillationsZ = 10
height = 50.0
number_of_layers = int(height/layer_height)
print("layers: ", number_of_layers)

bottom_diameter = 30.0
top_diameter = 35.0
diameter = bottom_diameter
radius = diameter/2
circumference = diameter * math.pi
c_inc = circumference/step_size
diameter_inc = (top_diameter-bottom_diameter)/(height/layer_height)
print("diameter increment: ", diameter_inc)

t.lift(-.5)
amplitudeXY = 8
oscillationsXY = 5
filled_oscillating_circle_xy(diameter, amplitudeXY, oscillationsXY, t)
t.lift(layer_height/2)


for l in range(0,number_of_layers):
    print("x at beginning", t.getX())
    #theta_offset = .5*(l%2)
    #oscillating_circle_z(diameter, amplitude, nOscillations, t)
    oscillating_circle_xyz(diameter, amplitudeXY, amplitudeZ, oscillationsXY, oscillationsXY, t, spiral_up=True)
    #amplitudeZ = amplitudeZ+.005
    if (amplitudeXY < 20):
        amplitudeXY = amplitudeXY + .2
    diameter = diameter + diameter_inc
    circumference = diameter * math.pi
    c_inc = circumference/step_size
    t.write_gcode_comment("finished one layer")
    print("x at end", t.getX())

oscillating_circle_xyz(diameter, amplitudeXY, amplitudeZ, oscillationsXY, oscillationsXY, t, spiral_up=False)
    
    

#####################################################


lines = []
for l in t.line_segs:
    if (l[0] != l[1]):
        lines.append(rs.AddLine(l[0], l[1]))

extrusion = []
i = 0
for e in t.extrusion_history:
    if (i>0 and i < len(lines)):
        distance = rs.CurveLength(lines[i])
        density = e/distance
        extrusion.append(extrude_width)
    i=i+1

t.finish()
# ---------- end python_2 ----------
line = Line(python_2.lines)
srf = Surface(python_2.turtle)
pipe = Pipe(Curve=line, Radius=python_2.extrusion, Caps=0)
