# Grasshopper definition cup_osciillations_2_2022.gh (Grasshopper 1.0.7)

trigger = Trigger(Interval=-1000, TimerInterval=1000, Target=python)
python = GhPythonScript()  # -> out, file
# ---------- python: Python ----------
import rhinoscriptsyntax as rs

filter = "GCode (*.gcode)|*.gcode|All Files (*.*)|*.*||"
file = rs.SaveFileName("", filter)
# ---------- end python ----------
python_2 = GhPythonScript(file=python.file)  # -> out, lines, extrusion, turtle
# ---------- python_2: Python ----------
# code required so that library reloads appropriately
# must be above other import statements
import sys
to_delete = list()
for module in sys.modules:
    if "extruder_turtle" in module:
      to_delete.append(module)  
    if "basic_geometry" in module:
      to_delete.append(module) 
        
for module in to_delete:
    sys.modules.pop(module)
    
import rhinoscriptsyntax as rs
import numbers
import math
import random
import extruder_turtle
import basic_geometry
from extruder_turtle import *
from basic_geometry import *

reload(extruder_turtle)
reload(basic_geometry)

t = ExtruderTurtle()

t.use_degrees = True
t.setup(x=0, y=0, z=0.0, filename=file)


amplitudeXY = 1.2
oscillationsXY = 20
amplitudeZ = 0


t.write_gcode_comment("***************PARAMETERS**************")
t.write_gcode_comment("nozzle = " + str(nozzle))
t.write_gcode_comment("speed = " + str(speed))
t.write_gcode_comment("extrued width = " + str(extrude_width))
t.write_gcode_comment("extrued rate = " + str(extrude_rate))
t.write_gcode_comment("layer height = " + str(layer_height))

lift_amount = 0.0
t.write_gcode_comment("initial lift = " + str(lift_amount))
diameter = 60
t.write_gcode_comment("initial diameter = " + str(diameter))
height = 125
t.write_gcode_comment("height = " + str(height))
t.write_gcode_comment("number of xy oscillations = " + str(oscillationsXY))
t.write_gcode_comment("amplitude of xy oscillations = " + str(amplitudeXY))
t.write_gcode_comment("diameter f(layers) = " + "diameter +=.04")


t.write_gcode_comment("***************PARAMETERS END**************")

steps = 100
layers = int(height/layer_height)
half_layers = int(layers/2)

#bottom of vessel
t.set_extrude_rate(1.6)
t.set_feedrate(speed) 
t.lift(lift_amount)
filled_oscillating_circle_xy(diameter, amplitudeXY, oscillationsXY, t)

    
#sides of vessel
t.set_extrude_rate(6.0)
t.set_feedrate(300) 

print("layers = " +str(layers+5))

for l in range (layers):
    oscillating_circle_xyz(diameter, amplitudeXY, amplitudeZ, oscillationsXY, oscillationsXY, t, spiral_up=True, theta_offset=l*2)
        
    diameter +=.2
    

oscillating_circle_xyz(diameter, amplitudeXY, amplitudeZ, oscillationsXY, oscillationsXY, t, spiral_up=False)

#####################################################


lines = []
for l in t.line_segs:
    if (l[0] != l[1]):
        lines.append(rs.AddLine(l[0], l[1]))

extrusion = []
i = 0
for e in t.extrusion_history:
    if (i>0 and i < len(lines)):
        distance = rs.CurveLength(lines[i])
        density = e/distance
        extrusion.append(extrude_width/10)
    i=i+1

t.finish()
# ---------- end python_2 ----------
line = Line(python_2.lines)
srf = Surface(python_2.turtle)
dam = DataDam(DataA=line, BufferDelay=10000000, BufferMode=0)
pipe = Pipe(Curve=dam, Radius=1, Caps=0)
