# Grasshopper definition cup_square_oscillations.gh (Grasshopper 1.0.7)

python = GhPythonScript()  # -> out, file
# ---------- python: Python ----------
import rhinoscriptsyntax as rs

filter = "GCode (*.gcode)|*.gcode|All Files (*.*)|*.*||"
file = rs.SaveFileName("", filter)
# ---------- end python ----------
python_2 = GhPythonScript(file=python.file)  # -> out, lines, extrusion, turtle
# ---------- python_2: Python ----------
# code required so that library reloads appropriately
# must be above other import statements
import sys
to_delete = list()
for module in sys.modules:
    if "extruder_turtle" in module:
      to_delete.append(module)  
    if "basic_geometry" in module:
      to_delete.append(module) 
        
for module in to_delete:
    sys.modules.pop(module)
    
import rhinoscriptsyntax as rs
import numbers
import math
import random
import extruder_turtle
import basic_geometry
from extruder_turtle import *
from basic_geometry import *

reload(extruder_turtle)
reload(basic_geometry)

t = ExtruderTurtle()
t.use_degrees = True
t.setup(x=0, y=0, z=0.0, filename=file)
t.set_extrude_rate(extrude_rate)
t.set_feedrate(700)

t.write_gcode_comment("***************PARAMETERS**************")
t.write_gcode_comment("extrued width = " + str(extrude_width))
t.write_gcode_comment("layer height = " + str(layer_height))

lift_amount = layer_height + .5
t.write_gcode_comment("initial lift = " + str(lift_amount))

inner_diameter = 80.0
t.write_gcode_comment("inner_diameter = " + str(inner_diameter))
outer_diameter = 95.0
t.write_gcode_comment("outer_diameter = " + str(outer_diameter))
height = 100.0
t.write_gcode_comment("height = " + str(height))
steps = 500
inner_radius = inner_diameter/2
outer_radius = outer_diameter/2
r_dif = outer_radius-inner_radius
inner_circumference = math.pi*inner_diameter
outer_circumference = math.pi*outer_diameter
inner_c_step = inner_circumference/steps
outer_c_step = outer_circumference/steps
theta_step = 360.0/steps
layers = int(height/layer_height)
d_change = .5
nOscillations = 10
oChange = .32
t.write_gcode_comment("number of XY osciallations = " + str(nOscillations))
t.write_gcode_comment("function (l= layer): 1*math.sin(math.radians(l*7.0))+.25")
t.write_gcode_comment("change in oscillation depth: " + str(oChange))


t.lift(lift_amount)
polygon_layer(outer_diameter, steps, t)
t.lift(layer_height)
t.set_position(x=0.000000001,y=0.000000001)
polygon_layer(outer_diameter, steps, t)
t.right(180)
#turtle = t.draw_turtle()
t.left(90)
t.forward(r_dif)
t.right(90)
t.lift(layer_height)
t.set_feedrate(1000)


for l in range (layers):
    square_oscillating_circle(inner_diameter, outer_diameter, nOscillations, t, steps=steps)
    v_f = 1*math.sin(math.radians(l*7.0))+.25

    if (inner_diameter < outer_diameter):
        inner_diameter = inner_diameter-v_f+oChange
        t.left(90)
        t.forward((v_f-oChange)/2)
        t.right(90)
    else:
        inner_diameter = outer_diameter-v_f
        t.left(90)
        t.forward((v_f)/2)
        t.right(90)
    outer_diameter = outer_diameter-v_f
    if (l != layers-1):
        t.lift(layer_height)

turtle = t.draw_turtle()
new_height = 50
new_layers = int(new_height/layer_height)

'''
for l in range (layers,layers+new_layers):
    square_oscillating_circle(inner_diameter, outer_diameter, nOscillations, t)
    v_f = 2*math.sin(math.radians(l*4))-.6
    t.left(90)
    t.forward((v_f-.3)/2)
    t.right(90)
    if (l != layers+new_layers-1):
        t.lift(layer_height)
    inner_diameter = inner_diameter-v_f+.3
    outer_diameter = outer_diameter-v_f
'''

'''
height = 20.0
new_layers = int(height/layer_height)
for l in range (layers,new_layers+layers):
    for i in range(0,nOscillations):
        for j in range (0,int(steps/nOscillations)):
            t.forward(inner_c_step)
            t.left(theta_step)
        t.right(90)
        t.forward(r_dif)
        t.left(90)
        for j in range (0,int(steps/nOscillations)):
            t.forward(outer_c_step)
            t.left(theta_step)
        t.left(90)
        t.forward(r_dif)
        t.right(90)
    t.right(90)
    t.forward((l*l/300)/2)
    t.left(90)
    t.lift(layer_height)
    inner_diameter = inner_diameter+(l*l/300)
    outer_diameter = outer_diameter+(l*l/300)
    inner_circumference = math.pi*inner_diameter
    outer_circumference = math.pi*outer_diameter
    inner_c_step = inner_circumference/steps
    outer_c_step = outer_circumference/steps
'''


#####################################################


lines = []
for l in t.line_segs:
    if (l[0] != l[1]):
        lines.append(rs.AddLine(l[0], l[1]))

extrusion = []
i = 0
for e in t.extrusion_history:
    if (i>0 and i < len(lines)):
        distance = rs.CurveLength(lines[i])
        density = e/distance
        extrusion.append(extrude_width)
    i=i+1

t.finish()
# ---------- end python_2 ----------
line = Line(python_2.lines)
srf = Surface(python_2.turtle)
dam = DataDam(DataA=python_2.extrusion, BufferDelay=10000000, BufferMode=0)
pipe = Pipe(Curve=line, Radius=dam, Caps=0)  # disabled
