# Grasshopper definition cup_z_osciillations.gh (Grasshopper 1.0.7)

python = GhPythonScript()  # -> out, file
# ---------- python: Python ----------
import rhinoscriptsyntax as rs

filter = "GCode (*.gcode)|*.gcode|All Files (*.*)|*.*||"
file = rs.SaveFileName("", filter)
# ---------- end python ----------
python_2 = GhPythonScript(file=python.file)  # -> out, lines, extrusion, turtle
# ---------- python_2: Python ----------
# code required so that library reloads appropriately
# must be above other import statements
import sys
to_delete = list()
for module in sys.modules:
    if "extruder_turtle" in module:
      to_delete.append(module)  
    if "basic_geometry" in module:
      to_delete.append(module) 
        
for module in to_delete:
    sys.modules.pop(module)
    
import rhinoscriptsyntax as rs
import numbers
import math
import random
import extruder_turtle
import basic_geometry
from extruder_turtle import *
from basic_geometry import *

reload(extruder_turtle)
reload(basic_geometry)

t = ExtruderTurtle()
t.use_degrees = True
t.setup(x=0, y=0, z=0.0, filename=file)
t.set_extrude_rate(extrude_rate)

t.write_gcode_comment("***************PARAMETERS**************")
t.write_gcode_comment("nozzle = " + str(nozzle))
t.write_gcode_comment("speed = " + str(speed))
t.write_gcode_comment("extrued width = " + str(extrude_width))
t.write_gcode_comment("extrued rate = " + str(extrude_rate))
t.write_gcode_comment("layer height = " + str(layer_height))

lift_amount = 0.0
t.write_gcode_comment("initial lift = " + str(lift_amount))

diameter = 85.0
t.write_gcode_comment("outer_diameter = " + str(diameter))
height = 90.0
t.write_gcode_comment("height = " + str(height))
steps = 500

layers = int(height/layer_height)
half_layers = int(layers/2)

z_increment = .016
t.write_gcode_comment("z increment = " + str(z_increment))
t.write_gcode_comment("max z = " + str(z_increment * half_layers))
t.write_gcode_comment("***************PARAMETERS END**************")

#bottom of vessel
t.set_feedrate(speed) 
t.lift(lift_amount)
polygon_layer(diameter, steps, t)
t.lift(layer_height)
t.set_position(x=0.001,y=0.001)
polygon_layer(diameter, steps, t)


#sides of vessel
num_oscillations = 5;
t.set_feedrate(speed) #regular speed for sides

z_amp = 0
t.lift(layer_height/2)

print("layers = " +str(layers+5))

for l in range (2):
    oscillating_circle_z(diameter, 0, num_oscillations, t, steps, True)
    
for l in range (half_layers):
    #def oscillating_circle_z(diameter, amplitude, nOscillations, t, steps=100, spiral_up = False):
    oscillating_circle_z(diameter, z_amp, num_oscillations, t, steps, True)
    z_amp += z_increment
    
print("max oscillation amplitude = " +str(z_amp))
 
for l in range (half_layers, layers):
    #def oscillating_circle_z(diameter, amplitude, nOscillations, t, steps=100, spiral_up = False):
    oscillating_circle_z(diameter, z_amp, num_oscillations, t, steps, True)
    z_amp -= z_increment
   
for l in range (2):
    #def oscillating_circle_z(diameter, amplitude, nOscillations, t, steps=100, spiral_up = False):
    oscillating_circle_z(diameter, 0, num_oscillations, t, steps, True)
   
oscillating_circle_z(diameter, 0, num_oscillations, t, steps, False)

#####################################################


lines = []
for l in t.line_segs:
    if (l[0] != l[1]):
        lines.append(rs.AddLine(l[0], l[1]))

extrusion = []
i = 0
for e in t.extrusion_history:
    if (i>0 and i < len(lines)):
        distance = rs.CurveLength(lines[i])
        density = e/distance
        extrusion.append(extrude_width/10)
    i=i+1

t.finish()
# ---------- end python_2 ----------
line = Line(python_2.lines)
srf = Surface(python_2.turtle)
dam = DataDam(DataA=line, BufferDelay=10000000, BufferMode=0)
dam_2 = DataDam(DataA=python_2.extrusion, BufferDelay=10000000, BufferMode=0)
pipe = Pipe(Curve=dam, Radius=1, Caps=0)
