# Grasshopper definition random_bumps.gh (Grasshopper 1.0.7)

trigger = Trigger(Interval=-1000, TimerInterval=1000, Target=python)
python = GhPythonScript()  # -> out, file
# ---------- python: Python ----------
import rhinoscriptsyntax as rs

filter = "GCode (*.gcode)|*.gcode|All Files (*.*)|*.*||"
file = rs.SaveFileName("", filter)
# ---------- end python ----------
python_2 = GhPythonScript(file=python.file)  # -> out, lines, extrusion, turtle
# ---------- python_2: Python ----------
# code required so that library reloads appropriately
# must be above other import statements
import sys
to_delete = list()
for module in sys.modules:
    if "extruder_turtle" in module:
      to_delete.append(module)  
    if "basic_geometry" in module:
      to_delete.append(module) 
        
for module in to_delete:
    sys.modules.pop(module)
    
import rhinoscriptsyntax as rs
import numbers
import math
import random
import extruder_turtle
import basic_geometry
from extruder_turtle import *
from basic_geometry import *

reload(extruder_turtle)
reload(basic_geometry)

t = ExtruderTurtle()

t.use_degrees = True
t.setup(x=0, y=0, z=0.0, filename=file)

t.set_extrude_rate(extrude_rate)

amplitudeXY = 1.2
oscillationsXY = 20
amplitudeZ = 0


t.write_gcode_comment("***************PARAMETERS**************")
t.write_gcode_comment("nozzle = " + str(nozzle))
t.write_gcode_comment("speed = " + str(speed))
t.write_gcode_comment("extrued width = " + str(extrude_width))
t.write_gcode_comment("extrued rate = " + str(extrude_rate))
t.write_gcode_comment("layer height = " + str(layer_height))

lift_amount = 0.0
t.write_gcode_comment("initial lift = " + str(lift_amount))
diameter = 60.0
t.write_gcode_comment("initial diameter = " + str(diameter))
height = 125.0
t.write_gcode_comment("height = " + str(height))
t.write_gcode_comment("number of xy oscillations = " + str(oscillationsXY))
t.write_gcode_comment("amplitude of xy oscillations = " + str(amplitudeXY))
t.write_gcode_comment("diameter f(layers) = " + "diameter +=.4")


t.write_gcode_comment("***************PARAMETERS END**************")

steps = 360
layers = int(height/layer_height)
half_layers = int(layers/2)
    
#sides of vessel
t.set_feedrate(speed) #regular speed for sides

print("layers = " +str(layers))

circumference = diameter * math.pi
c_inc = circumference/steps
z_inc = layer_height/steps

t.forward(diameter/2)
t.right(90)

dtheta = 360.0/steps
v = steps
v_step = int(steps/layers)*4

def spiral(s,v,v_steps):
    if (s == v):
        t.left(90)
        t.forward(5)
        t.backward(5)
        t.right(90)
        v= v- v_step
        if (v<=0):
            v = steps

v = steps/12

for i in range (0,2):
    polygon_layer(diameter, 100, t, True)
    t.lift(layer_height)

lift_amount = 0

polygon_layer(diameter, 100, t)
for l in range (layers):
    circumference = diameter * math.pi
    c_inc = circumference/steps
    #one circle
    s=1
    while (s<steps+1):
        t.forward(c_inc)
        t.right(dtheta)
        t.lift(z_inc)
        #if (random.randint(0, steps)> steps-10):
        if (s == v or s == v*4):
            for j in range(int(steps/12)):
                if (j<int(steps/24)):
                    t.lift(.02*l)
                else:
                    t.lift(-.02*l)
                t.forward(c_inc)
                t.right(dtheta)
                t.lift(z_inc)
                s+=1
        s+=1
        
    t.left(90)
    t.forward(.2)
    t.right(90)
    diameter = diameter+.4
    
for s in range(1,steps+1):
    t.forward(c_inc)
    t.right(dtheta)


#####################################################


lines = []
for l in t.line_segs:
    if (l[0] != l[1]):
        lines.append(rs.AddLine(l[0], l[1]))

extrusion = []
i = 0
for e in t.extrusion_history:
    if (i>0 and i < len(lines)):
        distance = rs.CurveLength(lines[i])
        density = e/distance
        extrusion.append(extrude_width/10)
    i=i+1

t.finish()
# ---------- end python_2 ----------
line = Line(python_2.lines)
srf = Surface(python_2.turtle)
pipe = Pipe(Radius=1, Caps=0)  # disabled
