# Grasshopper definition cylinder.gh (Grasshopper 1.0.7)

diameter = Slider(30, range=0..100)
height = Slider(25, range=0..100)
trigger = Trigger(Interval=-1, TimerInterval=5, Target=python)  # disabled
python = GhPythonScript()  # -> out, file
# ---------- python: Python ----------
# script to generate a file for .gcode

import rhinoscriptsyntax as rs

filter = "GCode (*.gcode)|*.gcode|All Files (*.*)|*.*||"
file = rs.SaveFileName("", filter)
# ---------- end python ----------
python_2 = GhPythonScript(file=python.file, diameter=diameter, height=height)  # -> out, lines, turtle, print_bed
# ---------- python_2: Python ----------
import rhinoscriptsyntax as rs
import extruder_turtle
from extruder_turtle import *
import math

#define a function that draws a circle
def circle (diameter):
    steps = 360
    circumference = diameter * math.pi
    c_inc = circumference/steps
    theta_inc = 360/steps

    for i in range(steps):
        t.forward(c_inc)
        t.right(theta_inc)

# set up the turtle
t = ExtruderTurtle()
t.setup(x=0, y=0, z=0.0, filename=file, printer = "eazao")
t.print_printer_information()
layer_height = t.get_layer_height()
        
t.forward(diameter/2)
t.right(90)
layers = int(height/layer_height)

for i in range(layers):
    circle(diameter)
    t.lift(layer_height)


# visualize the turtle's location and position
turtle = t.draw_turtle()
print_bed = t.draw_print_bed()

# visualize the turtle's path
lines = t.get_lines()

# close the generated .gcode file
t.finish()
# ---------- end python_2 ----------
srf = Surface(python_2.turtle)
srf_2 = Surface(python_2.print_bed)
