# Grasshopper definition euclidean_geometry.gh (Grasshopper 1.0.8)
# plug-ins: RhinoCodePluginGH

# This program mixes turtle geometry and euclidean geometry.
# More information: https://handandmachine.org/projects/extruder_turtle_rhino/examples.html
py3 = Python3Script()  # -> out, file
# ---------- py3: Python ----------
# script to generate a file for .gcode

import rhinoscriptsyntax as rs

filter = "GCode (*.gcode)|*.gcode|All Files (*.*)|*.*||"
file = rs.SaveFileName("", filter)
# ---------- end py3 ----------
py3_2 = Python3Script(file=py3.file, radius=Slider(30, range=0..100))  # -> out, lines, turtle, print_bed; inputs file: String
# ---------- py3_2: Python ----------
import rhinoscriptsyntax as rs
import extruder_turtle
from extruder_turtle import *
import math

# set up the turtle and associate the turtle with a specific printer
t = ExtruderTurtle()
t.setup(filename=file, printer = "ender")

# print out important printer parameters
t.print_printer_information()

# *************************************
# main part of program
# *************************************

for i in range (0,361):
    # euclidean geometry: circle
    x = radius * math.cos(math.radians(i))
    y = radius * math.sin(math.radians(i))
    # set the turtle's position using coordinates
    t.set_position(x,y)
    if (i>0 and i%10 == 0):
        # turtle geometry: spikes
        t.right(90)
        t.forward(5)
        t.back(5)
        t.left(90)
    
# *************************************
# end main part of program
# *************************************

# visualize the turtle's location and position
turtle = t.draw_turtle()

# visualize the printer's print bed
print_bed = t.draw_print_bed()

# get the path the turtle has traveled to visualize in Rhino
lines = t.get_lines()

# get print time and print it
time = t.get_print_time()
print("Approximate print time in minutes: " +str(time))

# close the generated .gcode file
t.finish()
# ---------- end py3_2 ----------
srf = Surface(py3_2.turtle)
srf_2 = Surface(py3_2.print_bed)
crv = Curve(py3_2.lines)
