# Grasshopper definition lutum_dual_extrusion.gh (Grasshopper 1.0.7)

python = GhPythonScript()  # -> out, file
# ---------- python: Python ----------
# script to generate a file for .gcode

import rhinoscriptsyntax as rs

filter = "GCode (*.gcode)|*.gcode|All Files (*.*)|*.*||"
file = rs.SaveFileName("", filter)
# ---------- end python ----------
# This is a simple program that demonstrates how to reload the Extruder Turtle library from Grasshopper.
# More information: https://handandmachine.org/projects/extruder_turtle_rhino/examples.html
python_2 = GhPythonScript()  # -> out, file; same code as python
panel = Panel(python.file)
panel_2 = Panel(python_2.file)
python_3 = GhPythonScript(file=python.file)  # -> out, lines0, lines1, extrude_width, turtle, print_bed
# ---------- python_3: Python ----------
# code required so that library reloads
# use if you want to make edits to library
# and have the changes compiled here
# must be above other import statements
import sys
import operator as op
to_delete = list()
for module in sys.modules:
    if "extruder_turtle" in module:
      to_delete.append(module)
for module in to_delete:
    sys.modules.pop(module)

# begin standard import statements    
import rhinoscriptsyntax as rs
import extruder_turtle
from extruder_turtle import *
from extruder_turtle import turtle_utilities as tu
import math

# set up the turtle and associate the turtle with a specific printer
t0 = ExtruderTurtle()
t0.setup(filename=file, printer = "lutum")
t1 = t0.create_subturtle()

t1.set_extrude_rate(t0.get_extrude_rate()*5)
t1.set_speed(t0.get_speed()/4)

t0.set_speed(t0.get_speed())
layer_height = t0.get_layer_height()
extrude_width=t0.get_extrude_width()

def cylinder(diameter, step_size=4.0):
    position = t0.get_position()
    initial_angle = t0.get_yaw()

    circumference = diameter * math.pi
    steps = int(circumference/step_size)
    c_inc = circumference/steps
    dtheta = 360.0/steps
    #print("steps: " +str(steps))
    #print("c_inc: " +str(c_inc))

    t0.right(dtheta/2)
    
    for i in range (steps):
        if (i==10 or i==15):
            t1.change_tool(t0,1)
            t1.extrude(5)
            t1.forward(c_inc)
            t1.right(dtheta)
            
        elif (i==11 or i==16):
            t1.forward(c_inc)
            t1.right(dtheta)
            t0.change_tool(t1,0)
            t0.extrude(3)
            
        else:
            t0.forward(c_inc)
            t0.right(dtheta)

    t0.set_heading(initial_angle)
    
t0.lift(layer_height*2.0)
t0.extrude(10)
t0.lift(layer_height*-1.0)

for i in range (0,30):
    cylinder(70)
    t0.lift(layer_height)

# visualize the turtle's location and position
turtle = t0.draw_turtle()

# visualize the printer's print bed
print_bed = t0.draw_print_bed()

# get the path the turtle has traveled to visualize in Rhino
lines0 = t0.get_lines()
lines1 = t1.get_lines()


# close the generated .gcode file
t0.finish()
# ---------- end python_3 ----------
python_4 = GhPythonScript(file=python_2.file)  # -> out, lines0, lines1, extrude_width, turtle, print_bed
# ---------- python_4: Python ----------
# code required so that library reloads
# use if you want to make edits to library
# and have the changes compiled here
# must be above other import statements
import sys
import operator as op
to_delete = list()
for module in sys.modules:
    if "extruder_turtle" in module:
      to_delete.append(module)
for module in to_delete:
    sys.modules.pop(module)

# begin standard import statements    
import rhinoscriptsyntax as rs
import extruder_turtle
from extruder_turtle import *

# set up the turtle and associate the turtle with a specific printer
t0 = ExtruderTurtle()
t0.setup(filename=file, printer = "lutum")
t1 = t0.create_subturtle()
t1.set_extrude_rate(t0.get_extrude_rate()*5)
t0.set_extrude_rate(t0.get_extrude_rate())
t1.set_speed(t0.get_speed()/4)
t0.set_speed(t0.get_speed())

extrude_width=t0.get_extrude_width()

length = 100
iterations = int(length/(t0.get_extrude_width()*2))
bottom_layers = 4

for j in range(0,bottom_layers):
    for i in range (0,iterations+1):
        t0.forward(length)
        t0.right(90)
        t0.forward(t0.get_extrude_width()*1.0)
        t0.right(90)
        t0.forward(length)
        if (i<iterations):
            t0.left(90)
            t0.forward(t0.get_extrude_width()*1.0)
            t0.left(90)
    
    t0.right(90)
    t0.lift(t0.get_layer_height())




space = 10 #space between centers of lines, not space between edges of lines
iterations2 = int((length-20)/(space*2))

t1.change_tool(t0,1)
t1.penup()
t1.forward(10)
t1.right(90)
t1.forward(10)
t1.pendown()

for i in range(0,iterations2):
    t1.forward(length-20)
    
    t1.penup()
    t1.left(90)
    t1.forward(space)
    t1.left(90)
    t1.pendown()
    t1.extrude(5)
    
    t1.forward(length-20)
    
    t1.penup()
    t1.right(90)
    t1.forward(space)
    t1.right(90)
    t1.pendown()

t1.forward(length-20)

t1.penup()
t1.lift(t1.get_layer_height())
t1.set_position(0,-20)
t1.set_heading(0)

t0.change_tool(t1,0)

for i in range (0,iterations-10+1):
    t0.forward(length)
    t0.right(90)
    t0.forward(t0.get_extrude_width()*1.0)
    t0.right(90)
    t0.forward(length)
    if (i<iterations-10):
        t0.left(90)
        t0.forward(t0.get_extrude_width()*1.0)
        t0.left(90)

# visualize the turtle's location and position
turtle = t0.draw_turtle()

# visualize the printer's print bed
print_bed = t0.draw_print_bed()

# get the path the turtle has traveled to visualize in Rhino
lines0 = t0.get_lines()
lines1 = t1.get_lines()


# close the generated .gcode file
t0.finish()
# ---------- end python_4 ----------
srf = Surface(python_3.print_bed)
srf_2 = Surface(python_4.print_bed)
line = Line(python_3.lines1)
line_2 = Line(python_4.lines1)
line_3 = Line(python_3.lines0)
line_4 = Line(python_4.lines0)
number_slider = Slider(113, range=0..255)
pipe = Pipe(Curve=line, Radius=python_3.extrude_width, Caps=0)
number_slider_2 = Slider(113, range=0..255)
pipe_2 = Pipe(Curve=line_2, Radius=python_4.extrude_width, Caps=0)
number_slider_3 = Slider(190, range=0..255)
number_slider_4 = Slider(190, range=0..255)
pipe_3 = Pipe(Curve=line_3, Radius=python_3.extrude_width, Caps=0)
pipe_4 = Pipe(Curve=line_4, Radius=python_4.extrude_width, Caps=0)
rgb = ColourRGB(Alpha=255, Red=number_slider_3, Green=0, Blue=number_slider_3)
rgb_2 = ColourRGB(Alpha=255, Red=number_slider, Green=number_slider, Blue=Slider(77, range=0..255))
rgb_3 = ColourRGB(Alpha=255, Red=number_slider_4, Green=0, Blue=number_slider_4)
rgb_4 = ColourRGB(Alpha=255, Red=number_slider_2, Green=number_slider_2, Blue=Slider(77, range=0..255))
move = Move(Geometry=pipe, Motion=Vector(0, 100, 0))  # -> Geometry, Transform
move_2 = Move(Geometry=pipe_3, Motion=Vector(0, 100, 0))  # -> Geometry, Transform
preview = CustomPreview(Geometry=pipe_4, Material=rgb_4)
preview_2 = CustomPreview(Geometry=pipe_2, Material=rgb_3)
preview_3 = CustomPreview(Geometry=move_2.Geometry, Material=rgb_2)
preview_4 = CustomPreview(Geometry=move.Geometry, Material=rgb)
