# Grasshopper definition polygon.gh (Grasshopper 1.0.7)

size = Slider(18, range=0..100)
number_sides = Slider(5, range=3..10)
# This program generates a 3D shape by stacking a series of polygons.
# More information: https://handandmachine.org/projects/extruder_turtle_rhino/examples.html
python = GhPythonScript()  # -> out, file
# ---------- python: Python ----------
# script to generate a file for .gcode

import rhinoscriptsyntax as rs

filter = "GCode (*.gcode)|*.gcode|All Files (*.*)|*.*||"
file = rs.SaveFileName("", filter)
# ---------- end python ----------
panel = Panel(python.file)
python_2 = GhPythonScript(file=python.file, size=size, number_sides=number_sides, layers=Slider(70, range=0..100))  # -> out, lines, turtle, print_bed; inputs number_sides: Int32, layers: Int32
# ---------- python_2: Python ----------
import rhinoscriptsyntax as rs
import extruder_turtle
from extruder_turtle import *

# set up the turtle
t = ExtruderTurtle()
t.setup(x=0, y=0, z=0.0, filename=file, printer = "ender")

# print out important printer parameters
t.print_printer_information()


# main part of program
layer_height = t.get_layer_height()

for i in range(layers):
    # draw polygon
    for i in range(number_sides):
        t.forward(size)
        t.right(360/number_sides)
    #lift up to next layer
    t.lift(layer_height)


# visualize the turtle's location and position
turtle = t.draw_turtle()

# visualize the printer's print bed
print_bed = t.draw_print_bed()

# get the path the turtle has traveled to visualize in Rhino
lines = t.get_lines()

# get print time and print it
time = t.get_print_time()
print("Approximate print time in minutes: " +str(time))

# close the generated .gcode file
t.finish()
# ---------- end python_2 ----------
panel_2 = Panel(python_2.out)
