# Grasshopper definition reload_library.gh (Grasshopper 1.0.8)
# plug-ins: RhinoCodePluginGH

# This is a simple program that demonstrates how to reload the Extruder Turtle library from Grasshopper.
# More information: https://handandmachine.org/projects/extruder_turtle_rhino/examples.html
py3 = Python3Script()  # -> out, file
# ---------- py3: Python ----------
# script to generate a file for .gcode

import rhinoscriptsyntax as rs

filter = "GCode (*.gcode)|*.gcode|All Files (*.*)|*.*||"
file = rs.SaveFileName("", filter)
# ---------- end py3 ----------
py3_2 = Python3Script(file=py3.file)  # -> out, lines, turtle, print_bed; inputs file: String
# ---------- py3_2: Python ----------
# code required so that library reloads
# use if you want to make edits to library
# and have the changes compiled here
# must be above other import statements
import sys
import operator as op
to_delete = list()
for module in sys.modules:
    if "extruder_turtle" in module:
      to_delete.append(module)
for module in to_delete:
    sys.modules.pop(module)

# begin standard import statements    
import rhinoscriptsyntax as rs
import extruder_turtle
from extruder_turtle import *

# set up the turtle and associate the turtle with a specific printer
t = ExtruderTurtle()
t.setup(filename=file, printer = "ender")

# print out important printer parameters
t.print_printer_information()

# do your turtle programming here
# this code draws a triangle
for i in range (0,3):
    t.forward(50)
    t.right(120)

# visualize the turtle's location and position
turtle = t.draw_turtle()

# visualize the printer's print bed
print_bed = t.draw_print_bed()

# get the path the turtle has traveled to visualize in Rhino
lines = t.get_lines()

# close the generated .gcode file
t.finish()
# ---------- end py3_2 ----------
