# Grasshopper definition simple_starting_example.gh (Grasshopper 1.0.7)

trigger = Trigger(Interval=-1, TimerInterval=5, Target=python)  # disabled
python = GhPythonScript()  # -> out, file
# ---------- python: Python ----------
# script to generate a file for .gcode

import rhinoscriptsyntax as rs

filter = "GCode (*.gcode)|*.gcode|All Files (*.*)|*.*||"
file = rs.SaveFileName("", filter)
# ---------- end python ----------
python_2 = GhPythonScript(file=python.file)  # -> out, lines, turtle, print_bed
# ---------- python_2: Python ----------
import rhinoscriptsyntax as rs
import extruder_turtle
from extruder_turtle import *
import turtle_utilities as tu

# set up the turtle
t = ExtruderTurtle()
t.setup(x=0, y=0, z=0.0, filename=file, printer = "super")
t.print_printer_information()


# visualize the turtle's location and position
turtle = t.draw_turtle()
print_bed = t.draw_print_bed()

# visualize the turtle's path
lines = t.get_lines()

# close the generated .gcode file
t.finish()
# ---------- end python_2 ----------
