# Grasshopper definition spiky_flower.gh (Grasshopper 1.0.7)

trigger = Trigger(Interval=-1, TimerInterval=5, Target=python)  # disabled
python = GhPythonScript()  # -> out, file
# ---------- python: Python ----------
# script to generate a file for .gcode

import rhinoscriptsyntax as rs

filter = "GCode (*.gcode)|*.gcode|All Files (*.*)|*.*||"
file = rs.SaveFileName("", filter)
# ---------- end python ----------
geo = Geometry(<curve referenced from the Rhino model>)
python_2 = GhPythonScript(x=geo)  # -> out, a, path; inputs x: Curve
# ---------- python_2: Python ----------
# code required so that library reloads appropriately
# must be above other import statements
import sys
import operator as op
to_delete = list()
for module in sys.modules:
    if "extruder_turtle" in module:
      to_delete.append(module)
    if "turtle_utilities" in module:
      to_delete.append(module)
for module in to_delete:
    sys.modules.pop(module)
    
import rhinoscriptsyntax as rs
import random
import extruder_turtle
import turtle_utilities as tu
from extruder_turtle import *

t = ExtruderTurtle()
t.setup(printer="eazao")

curve = x
a = tu.spiral_bottom(t,curve)

path = t.get_lines()
# ---------- end python_2 ----------
panel = Panel(python.file)
pt = Point(python_2.a)
python_3 = GhPythonScript(file=python.file, number_sides=Slider(14, range=3..30), size=Slider(9, range=3..30), layers=Slider(48, range=3..100))  # -> out, path, print_bed, turtle; inputs number_sides: Int32, size: Int32, layers: Int32
# ---------- python_3: Python ----------
# code required so that library reloads appropriately
# must be above other import statements
import sys
import operator as op
to_delete = list()
for module in sys.modules:
    if "extruder_turtle" in module:
      to_delete.append(module)
    if "turtle_utilities" in module:
      to_delete.append(module)
for module in to_delete:
    sys.modules.pop(module)
    
import rhinoscriptsyntax as rs
import random
import extruder_turtle
import turtle_utilities as tu
from extruder_turtle import *


t = ExtruderTurtle()
t.setup(filename=file, printer="eazao")
print(t.get_extrude_rate())

def spike_line(size, spike_size):
    t.forward(size/2)
    t.left(90)
    t.forward(spike_size)
    t.backward(spike_size)
    t.right(90)
    t.forward(size/2)
    
def random_spike_line(size, spike_size):
    rand_dist = random.randint(1,int(size))
    t.forward(rand_dist)
    t.left(90)
    t.forward(spike_size)
    t.backward(spike_size)
    t.right(90)
    t.forward(size-rand_dist)

def polygon(number_sides, size):
    for s in range(number_sides):
        random_spike_line(size,5)
        t.right(360/number_sides)
    
def polygon_stack(number_sides, size, layers):
    for l in range(layers):
        polygon(number_sides, size)
        t.lift(t.get_layer_height())
    polygon(number_sides, size)
    
def polygon_stack_grow(number_sides, size, layers):
    for l in range(layers):
        polygon(number_sides, size)
        t.lift(t.get_layer_height())
        size = size+1
    polygon(number_sides, size)
    
def flower_stack(number_sides, size, layers):
    for l in range(layers):
        petals = 5
        for p in range (petals):
            polygon(number_sides, size)
            t.right(360/petals)
        t.lift(t.get_layer_height())
        size = size+.1
    polygon(number_sides, size)


flower_stack(number_sides, size, layers)

turtle = t.draw_turtle()
path = t.get_lines()
print_bed = t.draw_print_bed()

t.finish()
# ---------- end python_3 ----------
panel_2 = Panel(python_2.path)
