# Grasshopper definition starting_example.gh (Grasshopper 1.0.8)
# plug-ins: RhinoCodePluginGH

# More information: https://handandmachine.org/projects/extruder_turtle_rhino/examples.html
py3 = Python3Script()  # -> out, file
# ---------- py3: Python ----------
# script to generate a file for .gcode

import rhinoscriptsyntax as rs

filter = "GCode (*.gcode)|*.gcode|All Files (*.*)|*.*||"
file = rs.SaveFileName("", filter)
# ---------- end py3 ----------
py3_2 = Python3Script(file=py3.file)  # -> out, lines, turtle, print_bed; inputs file: String
# ---------- py3_2: Python ----------
import rhinoscriptsyntax as rs
import extruder_turtle
from extruder_turtle import *

# set up the turtle and associate the 
# turtle with a specific printer
t = ExtruderTurtle()
t.setup(filename=file, printer = "ender")

# print out important printer parameters
t.print_printer_information()

# do your turtle programming here
# this code draws a square prism
for j in range (10):
    for i in range (4):
        t.forward(15) # units are in mm
        t.right(90)
    t.lift(t.get_layer_height())

# visualize the turtle's location 
# and position
turtle = t.draw_turtle()

# visualize the printer's print bed
print_bed = t.draw_print_bed()

# get the path the turtle has 
# traveled to visualize in Rhino
lines = t.get_lines()

# get the approximate print time
t.get_print_time()

# close the generated .gcode file
t.finish()
# ---------- end py3_2 ----------
# This is a simple program that demonstrates how to get started with the Extruder Turtle Library
# It generates a gcode file that follows the path of the turtle.
panel = Panel(py3.file)
srf = Surface(py3_2.turtle)
srf_2 = Surface(py3_2.print_bed)
line = Line(py3_2.lines)
panel_2 = Panel(py3_2.out)
