# Grasshopper definition turtle_shapes.gh (Grasshopper 1.0.8)
# plug-ins: RhinoCodePluginGH

# This program creates a set of more complex 3D shapes.
# More information: https://handandmachine.org/projects/extruder_turtle_rhino/examples.html
py3 = Python3Script()  # -> out, file
# ---------- py3: Python ----------
# script to generate a file for .gcode

import rhinoscriptsyntax as rs

filter = "GCode (*.gcode)|*.gcode|All Files (*.*)|*.*||"
file = rs.SaveFileName("", filter)
# ---------- end py3 ----------
py3_2 = Python3Script(file=py3.file)  # -> out, lines, turtle, print_bed; inputs file: String
# ---------- py3_2: Python ----------
import sys
import operator as op
to_delete = list()
for module in sys.modules:
    if "extruder_turtle" in module:
      to_delete.append(module)
for module in to_delete:
    sys.modules.pop(module)

import rhinoscriptsyntax as rs
import extruder_turtle
from extruder_turtle import *

# set up the turtle and associate the turtle with a specific printer
t = ExtruderTurtle()
t.setup(filename=file, printer = "ender")

# print out important printer parameters
t.print_printer_information()

# function definitions
def polygon_step(size, angle):
    t.forward(size)
    t.right(angle)

def polygon_halt(size, angle):
    rotation = angle
    t.forward(size)
    t.right(angle)
    while (rotation % 360 > 0):
        t.forward(size)
        t.right(angle)
        rotation = rotation + angle
        
# *************************************
# main part of program
# *************************************
layer_height = t.get_layer_height()

#shape 0
size = 20
angle = 119
for i in range(200):
    polygon_step(size, angle)
    t.lift(layer_height/(360/angle))
    size = size + layer_height

# shape 1
t.penup()
t.set_position(x=100,y=0,z=0)
t.pendown()
size = 20
angle = 100
for i in range(100):
    polygon_step(size, angle)
    t.lift(layer_height)
    size = size + layer_height
    
# shape 2
t.penup()
t.set_position(x=-100,y=0,z=0)
t.pendown()
size = 20
angle = 60
for i in range(200):
    polygon_halt(size, angle)
    t.left(60)
    t.lift(layer_height/(360/angle))
    
# *************************************
# end main part of program
# *************************************

# visualize the turtle's location and position
turtle = t.draw_turtle()

# visualize the printer's print bed
print_bed = t.draw_print_bed()

# get the path the turtle has traveled to visualize in Rhino
lines = t.get_lines()

# get print time and print it
time = t.get_print_time()
print("Approximate print time in minutes: " +str(time))

# close the generated .gcode file
t.finish()
# ---------- end py3_2 ----------
