# Grasshopper definition cylinder.gh (Grasshopper 1.0.7)

trigger = Trigger(Interval=-1, TimerInterval=5, Target=python)  # disabled
python = GhPythonScript()  # -> out, file
# ---------- python: Python ----------
import rhinoscriptsyntax as rs

filter = "GCode (*.gcode)|*.gcode|All Files (*.*)|*.*||"
file = rs.SaveFileName("", filter)
# ---------- end python ----------
python_2 = GhPythonScript(file=python.file)  # -> out, lines, turtle
# ---------- python_2: Python ----------
# code required so that library reloads appropriately
# must be above other import statements
import sys
to_delete = list()
for module in sys.modules:
    if "extruder_turtle" in module:
      to_delete.append(module)
for module in to_delete:
    sys.modules.pop(module)
    
import rhinoscriptsyntax as rs
import extruder_turtle
from extruder_turtle import *
import turtle_utilities as tu

t = ExtruderTurtle()
t.use_degrees = True
t.setup(x=0, y=0, z=0.0, filename=file, printer = "3D potter")

# write turtle code here

for i in range (10):
    for j in range(0,360):
        t.forward(1)
        t.right(1)
    t.lift(t.get_layer_height())
    
turtle = t.draw_turtle()

#####################################################

lines = t.get_lines()
t.finish()
# ---------- end python_2 ----------
line = Line(python_2.lines)
srf = Surface(python_2.turtle)
dam = DataDam(DataA=line, BufferDelay=10000000, BufferMode=0)
