# Grasshopper definition simple_cup_library_reload.gh (Grasshopper 1.0.7)

trigger = Trigger(Interval=-1, TimerInterval=5, Target=python)  # disabled
python = GhPythonScript()  # -> out, file
# ---------- python: Python ----------
# script to generate a file for .gcode

import rhinoscriptsyntax as rs

filter = "GCode (*.gcode)|*.gcode|All Files (*.*)|*.*||"
file = rs.SaveFileName("", filter)
# ---------- end python ----------
python_2 = GhPythonScript(file=python.file, diameter=Slider(50, range=0..100), height=Slider(75, range=0..100))  # -> out, lines, turtle
# ---------- python_2: Python ----------
# code required so that library reloads appropriately
# must be above other import statements
import sys
import operator as op
to_delete = list()
for module in sys.modules:
    if "extruder_turtle" in module:
      to_delete.append(module)
    if "turtle_utilities" in module:
      to_delete.append(module)
for module in to_delete:
    sys.modules.pop(module)
    
import rhinoscriptsyntax as rs
import extruder_turtle
import turtle_utilities as tu
from extruder_turtle import *

reload(extruder_turtle)

# set up the turtle
t = ExtruderTurtle()
t.setup(x=0, y=0, z=0.0, filename=file, printer = "3D potter")

# generate a 3 layer bottom
bottom_layers = 3
tu.circular_bottom(t,diameter,bottom_layers)

# generate body of cup
layers = int(height/t.get_layer_height())

for i in range(0,layers-1):
    tu.circular_layer(t,diameter)

#print the last layer without a spiral to create a smooth top
tu.circular_layer(t,diameter, spiral_up=False)

# visualize the turtle's location and position
turtle = t.draw_turtle()

# visualize the turtle's path
lines = t.get_lines()

# close the generated .gcode file
t.finish()
# ---------- end python_2 ----------
