# Grasshopper definition testing_slicer_camila.gh (Grasshopper 1.0.7)

python = GhPythonScript()  # -> out, file
# ---------- python: Python ----------
import rhinoscriptsyntax as rs

filter = "GCode (*.gcode)|*.gcode|All Files (*.*)|*.*||"
file = rs.SaveFileName("", filter)
# ---------- end python ----------
geo = Geometry(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)
python_2 = GhPythonScript(filename=python.file, shape=geo)  # -> out, lines, turtle, planes, surfaces; inputs shape: Brep
# ---------- python_2: Python ----------
# code required so that library reloads appropriately
# must be above other import statements
import sys
import operator as op
to_delete = list()
for module in sys.modules:
    if "extruder_turtle" in module:
      to_delete.append(module)
    if "turtle_utilities" in module:
      to_delete.append(module)
for module in to_delete:
    sys.modules.pop(module)
    
import rhinoscriptsyntax as rs
import extruder_turtle
import turtle_utilities as tu
from extruder_turtle import *

reload(extruder_turtle)

# set up the turtle
t = ExtruderTurtle()
t.setup(x=0, y=0, z=0.0, filename=filename, printer = "3D potter")
t.set_extrude_rate(7.0)

# slice the shape
# this function generates a turtle path that 
# follows the outer perimeter of the shape
# note: does not create a bottom
tu.slice_with_turtle_even_layers(t, shape, walls = 1)

turtle = t.draw_turtle()

# visualize the turtle's path
lines = t.get_lines()

# close the generated .gcode file
t.finish()
# ---------- end python_2 ----------
srf = Surface(python_2.turtle)
geo_2 = Geometry(python_2.surfaces)
panel = Panel(python_2.out)
