# Grasshopper definition testing_slicer_camila.gh (Grasshopper 1.0.7)

python = GhPythonScript()  # -> out, file
# ---------- python: Python ----------
import rhinoscriptsyntax as rs

filter = "GCode (*.gcode)|*.gcode|All Files (*.*)|*.*||"
file = rs.SaveFileName("", filter)
# ---------- end python ----------
geo = Geometry(<brep referenced from the Rhino model>)
edges = BrepEdges(Brep=geo)  # -> Naked, Interior, NonManifold
join = JoinCurves(Curves=edges.Interior, Preserve=False)
python_2 = GhPythonScript(filename=python.file, shape=geo)  # -> out, lines, turtle, planes, surfaces; inputs shape: Brep
# ---------- python_2: Python ----------
# code required so that library reloads appropriately
# must be above other import statements
import sys
import operator as op
to_delete = list()
for module in sys.modules:
    if "extruder_turtle" in module:
      to_delete.append(module)
    if "turtle_utilities" in module:
      to_delete.append(module)
for module in to_delete:
    sys.modules.pop(module)
    
import rhinoscriptsyntax as rs
import extruder_turtle
import turtle_utilities as tu
from extruder_turtle import *
import Rhino.Geometry as geom


reload(extruder_turtle)

# set up the turtle
t = ExtruderTurtle()
t.setup(x=0, y=0, z=0.0, filename=filename, printer = "3D potter")
t.set_extrude_rate(7.0)

# slice the shape
# this function generates a turtle path that 
# follows the outer perimeter of the shape
# note: does not create a bottom
planes = tu.non_planar_cylinder_slice_with_turtle(t, shape, walls = 1)

#surfaces = tu.surface_for_nonplanar_slice(100,0,100)
#points = rs.DivideCurve(planes[2], 10) + rs.DivideCurve(planes[3],10)

#print(rs.PointsAreCoplanar(points))


# visualize the turtle's path
lines = t.get_lines()

# close the generated .gcode file
t.finish()
# ---------- end python_2 ----------
cls = Closed(Curve=join)  # -> Closed, Periodic
dispatch = Dispatch(List=join, DispatchPattern=cls.Closed)  # -> ListA, ListB
srf = Surface(python_2.turtle)
panel = Panel(python_2.out)
geo_2 = Geometry(python_2.surfaces)
divide = DivideCurve(Curve=dispatch.ListA, Count=10, Kinks=False)  # -> Points, Tangents, Parameters
item = ListItem(List=python_2.planes, Index=Slider(4, range=0..10), Wrap=True)
panel_2 = Panel(python_2.planes)
srf_2 = Surface(item)
pt = Point()
