# Grasshopper definition turtle_slice.gh (Grasshopper 1.0.7)

# ----
# Sample shape to slice
radius_bottom = Slider(45, range=3..100)
radius_mid = Slider(50, range=3..100)
height = Slider(70, range=3..100)
facets = Slider(3, range=3..20)
radius_top = Slider(41, range=1..100)
python = GhPythonScript(facets=facets, height=height, radius_top=radius_top, radius_mid=radius_mid, radius_bottom=radius_bottom)  # -> out, points, polygons, curves; inputs facets: Int32
# ---------- python: Python ----------
__author__ = "Leah"

import rhinoscriptsyntax as rs
import math

def polyPoints (z, r):
    points = []
    for i in range (0,facets+1):
        angle = i*360/facets
        x = r*math.cos(math.radians(angle))
        y = r*math.sin(math.radians(angle))
        points.append(rs.CreatePoint(x,y,z))
    return points
    
def polygon(z, r):
    points = polyPoints(z,r)
    polygon = rs.AddPolyline(points)
    return polygon

def curvePoly(z, r):
    points = polyPoints(z,r)
    curve = rs.AddCurve(points,2)
    return curve

polygons = []
polygons.append(polygon(0,radius_bottom))
polygons.append(polygon(height/2,radius_mid))
polygons.append(polygon(height,radius_top))

curves = []
curves.append(curvePoly(0,radius_bottom))
curves.append(curvePoly(height/2,radius_mid))
curves.append(curvePoly(height,radius_top))

    
def cosPoints(z,in_r,a,b):
    points = []
    for i in range (0,360+1):
        r = in_r+a+a*math.cos(math.radians(i)*b)
        x = r*math.cos(math.radians(i))
        y = r*math.sin(math.radians(i))
        points.append(rs.CreatePoint(x,y,z))
    return points

def cosPoly(z,in_r,a,b):
    points = cosPoints(z,in_r,a,b)
    curve = rs.AddCurve(points)
    curve = rs.CloseCurve(curve,1)
    return curve
    
'''    
curves = []
curves.append(cosPoly(0,radius_bottom,.5,facets))
curves.append(cosPoly(height/2,radius_mid,.5,facets))
curves.append(cosPoly(height,radius_top,2,facets))
'''
# ---------- end python ----------
loft = Loft(Curves=python.curves, Options={Adjust=False, Closed=False, LoftEnds=0, LoftSimp=0, LoftType=0, Rebuild=10, Refit=0.01})
cap = CapHoles(Brep=loft)

radius_bottom_2 = Slider(40, range=3..100)
radius_mid_2 = Slider(20, range=3..100)
radius_top_2 = Slider(15, range=3..100)
height_2 = Slider(100, range=3..100)
facets_2 = Slider(3, range=3..20)
trigger = Trigger(Interval=-1000, TimerInterval=1000, Target=python_3)
python_2 = GhPythonScript(facets=facets_2, height=height_2, radius_top=radius_top_2, radius_mid=radius_mid_2, radius_bottom=radius_bottom_2)  # -> out, points, polygons, curves, bottom_surface; inputs facets: Int32
# ---------- python_2: Python ----------
__author__ = "Leah"

import rhinoscriptsyntax as rs
import math

def polyPoints (z, r, rotate=0):
    points = []
    for i in range (0,facets+1):
        angle = i*360/facets
        x = r*math.cos(math.radians(angle+rotate))
        y = r*math.sin(math.radians(angle+rotate))
        points.append(rs.CreatePoint(x,y,z))
    return points
    
def polygon(z, r, rotate=0):
    points = polyPoints(z,r,rotate)
    polygon = rs.AddPolyline(points)
    return polygon

def curvePoly(z,r,rotate=0):
    points = polyPoints(z,r,rotate)
    curve = rs.AddCurve(points)
    return curve

rotation = 90
polygons = []
polygons.append(polygon(0,radius_bottom))
polygons.append(polygon(height/2,radius_mid,rotation/2))
polygons.append(polygon(height,radius_top,rotation))


curves = []
curves.append(curvePoly(0,radius_bottom))
curves.append(curvePoly(height/2,radius_mid,rotation/2))
curves.append(curvePoly(height,radius_top,rotation))

    
def cosPoints(z,in_r,a,b):
    points = []
    for i in range (0,360+1):
        r = in_r+a+a*math.cos(math.radians(i)*b)
        x = r*math.cos(math.radians(i))
        y = r*math.sin(math.radians(i))
        points.append(rs.CreatePoint(x,y,z))
    return points

def cosPoly(z,in_r,a,b):
    points = cosPoints(z,in_r,a,b)
    curve = rs.AddCurve(points)
    curve = rs.CloseCurve(curve,1)
    return curve
    
    
curves = []
bottom_curve = cosPoly(0,radius_bottom,5,5)
bottom_surface = rs.AddPlanarSrf(bottom_curve)
curves.append(bottom_curve)
curves.append(cosPoly(height/2,radius_mid,5,10))
curves.append(cosPoly(height,radius_top,5,5))

curves = polygons
# ---------- end python_2 ----------
python_3 = GhPythonScript()  # -> out, file
# ---------- python_3: Python ----------
import rhinoscriptsyntax as rs

filter = "GCode (*.gcode)|*.gcode|All Files (*.*)|*.*||"
file = rs.SaveFileName("", filter)
# ---------- end python_3 ----------
loft_2 = Loft(Curves=python_2.curves, Options={Adjust=False, Closed=False, LoftEnds=0, LoftSimp=0, LoftType=0, Rebuild=10, Refit=0.01})
cap_2 = CapHoles(Brep=loft_2)
dam = DataDam(DataB=python_3.file, DataA=cap_2, BufferDelay=10000000, BufferMode=0)  # -> DataB, DataA
python_4 = GhPythonScript(filename=dam.DataB, shape=dam.DataA)  # -> out, lines, turtle; inputs shape: Brep
# ---------- python_4: Python ----------
# code required so that library reloads appropriately
# must be above other import statements
import sys
import operator as op
to_delete = list()
for module in sys.modules:
    if "extruder_turtle" in module:
      to_delete.append(module)
    if "turtle_utilities" in module:
      to_delete.append(module)
for module in to_delete:
    sys.modules.pop(module)
    
import rhinoscriptsyntax as rs
import extruder_turtle  
import turtle_utilities as tu
from extruder_turtle import *

reload(extruder_turtle)

# set up the turtle
t = ExtruderTurtle()
t.setup(x=0, y=0, z=0.0, filename=filename, printer = "micro")
layer_height = t.get_layer_height()
t.set_extrude_rate(7.0)
print("standard layer height is: " +str(layer_height))

# slice the shape
# this function generates a turtle path that 
# follows the outer perimeter of the shape
tu.slice_with_turtle(t, shape, layer_height=layer_height, walls = 1, spiral_up = True)

# visualize the turtle's path
lines = t.get_lines()

# close the generated .gcode file
t.finish()
# ---------- end python_4 ----------
line = Line(python_4.lines)
panel = Panel(python_4.out)
