# Grasshopper definition woven_cup.gh (Grasshopper 1.0.7)

trigger = Trigger(Interval=-1, TimerInterval=5, Target=python)  # disabled
python = GhPythonScript()  # -> out, file
# ---------- python: Python ----------
import rhinoscriptsyntax as rs

filter = "GCode (*.gcode)|*.gcode|All Files (*.*)|*.*||"
file = rs.SaveFileName("", filter)
# ---------- end python ----------
python_2 = GhPythonScript(file=python.file)  # -> out, lines, turtle
# ---------- python_2: Python ----------
import rhinoscriptsyntax as rs
import extruder_turtle
import turtle_utilities as tu
from extruder_turtle import *

# set up the turtle
t = ExtruderTurtle()
t.setup(x=0, y=0, z=0.0, filename=file, printer="eazao")

# parameters for cup diameter and height
diameter = 60
height = 70

# generate a 3 layer bottom
bottom_layers = 3
tu.circular_bottom(t,diameter,bottom_layers)

# generate body of cup
# oscillating circle basic arguments: 
# turtle, diameter, numnber of oscillations, amplitude of oscillations
layers = int(height/t.get_layer_height())
for l in range (int(layers/2)):
    tu.oscillating_circle(t,diameter, 45, 1)
    tu.oscillating_circle(t,diameter, 45, 1, theta_offset=180)

# visualize the turtle's path
lines = t.get_lines()

# close the generated .gcode file
t.finish()
# ---------- end python_2 ----------
