# Grasshopper definition weave_slicer.gh (Grasshopper 1.0.8)

complex_surface = Geometry(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)
rounded_cube = Geometry(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)
# This is a simple program that demonstrates how to get started with the WeaveSlicer Library
# It generates a gcode file with a toolpath for 3D printing. Choose from 3 shapes.
# More information: https://handandmachine.org/projects/weaveslicer/examples.html
py3 = Python3Script()  # -> out, file
# ---------- py3: Python ----------
import rhinoscriptsyntax as rs

filter = "GCode (*.gcode)|*.gcode|All Files (*.*)|*.*||"
file = rs.SaveFileName("", filter)
# ---------- end py3 ----------
vase = Geometry(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)
py3_2 = Python3Script(file=py3.file, shape=vase)  # -> out, toolpath; inputs file: String, shape: Brep
# ---------- py3_2: Python ----------
import weave_slicer as ws
toolpath = ws.weave_slice(shape, file=file, layer_height=1.0, wall_width=3.0, mode=3, bottom_layers=3)
# ---------- end py3_2 ----------
line = Line(py3_2.toolpath)
